# Dynamo graph streamDataToRevit.dyn (Dynamo 2.0.2.6826)

byCoordinates = Point.ByCoordinates()
code_block = CodeBlock { 6; }
byCoordinates_2 = Point.ByCoordinates(x=code_block, y=code_block)
list_create = List.Create(item0=byCoordinates, item1=byCoordinates_2)
byOriginNormal = Plane.ByOriginNormal(origin=list_create)
byWidthLength = Rectangle.ByWidthLength(plane=byOriginNormal, width=code_block, length=code_block)
code_block_2 = CodeBlock {  }
combine = List.Combine(list1=byCoordinates, list2=byCoordinates_2)  # unwired: comb
watch = Watch(combine)
list_create_2 = List.Create()  # unwired: item0
family_types = FamilyTypes(index=322)
file_path = Filename("DynamoWebsite\data1.csv")
boolean = BoolSelector(true)
importCSV = Data.ImportCSV(filePath=file_path, transpose=boolean)
code_block_3 = CodeBlock { 1; }
split = Custom[Springs.List.Split](list=importCSV, amount=code_block_3)  # Splits a list at the desired length
transpose = List.Transpose(lists=split.list2)
watch_2 = Watch(transpose)
code_block_4 = CodeBlock { 2; }
getItemAtIndex = List.GetItemAtIndex(list=watch_2, index=code_block_4)
watch_3 = Watch(getItemAtIndex)
code_block_5 = CodeBlock { 3; }
getItemAtIndex_2 = List.GetItemAtIndex(list=watch_2, index=code_block_5)
watch_4 = Watch(getItemAtIndex_2)
byCoordinates_3 = Point.ByCoordinates(x=watch_3, y=watch_4)
byPoint = FamilyInstance.ByPoint(familyType=family_types, point=byCoordinates_3)
watch_5 = Watch(byPoint)
string = StringInput("Width")
code_block_6 = CodeBlock { 4; }
getItemAtIndex_3 = List.GetItemAtIndex(list=watch_2, index=code_block_6)
setParameterByName = Element.SetParameterByName(element=watch_5, parameterName=string, value=getItemAtIndex_3)
code_block_7 = CodeBlock { "Width"; }
code_block_8 = CodeBlock { 10; }
string_2 = StringInput("Length")
code_block_9 = CodeBlock { 5; }
getItemAtIndex_4 = List.GetItemAtIndex(list=watch_2, index=code_block_9)
setParameterByName_2 = Element.SetParameterByName(element=watch_5, parameterName=string_2, value=getItemAtIndex_4)
